# Grasshopper definition antworld_test.gh (Grasshopper 0.9.72)
# plug-ins: Decodes Python Interpreter, Ants

panel = Panel("""count = 0

# for each cell in the neighborhood:
for i in n_vals:
    # if cell is True:
    if i == 1: 
        count += 1 # count it
        
# if home cell is True:
if h_val == 1:
    # if less than 2 or more than 3 neighbors are True:
    if (count < 2) or (count >3) :
        # this cell will be False in the next generation
        h_val = 0
    # else:
    else:
        # this cell will be True in the next generation
        h_val = 1
# else the home cell is False:
else:
    # if exactly 3 neighbors are True:
    if (count == 3):
        # this cell will be True in the next generation
        h_val = 1
    else:
        # else this cell will be False in the next generation
        h_val = 0

h_val = count""")
# count = 0
# for n in n_vals:
# 	if n == 1:
# 		count+=1
# 
# if h_val == 1:
# 	if count < 2 or count >3:
# 		h_val = 0;
# 	else:
# 		h_val = 1
# else:
# 	if count == 3:
# 		h_val = 1
# 	else:
# 		h_val = 0
number_slider = Slider(3, range=2..30)
number_slider_2 = Slider(3, range=2..30)
multiplication = Multiplication(A=number_slider_2, B=number_slider)
range = Range(Domain=multiplication, Steps=multiplication)
random = Random(Range=Domain(0, 1), Number=multiplication, Seed=Slider(0.5, range=0..1))
decodes = DecodesPythonScript()  # -> console, a
# ---------- decodes: Python ----------
a.put([0,0,1,0,1,0,0,1,0])
# ---------- end decodes ----------
toggle = BooleanToggle(True)
round = Round(Number=random)  # -> Nearest, Floor, Ceiling
gridworld = AntsGridWorld(Rows=number_slider_2, NumberOfColumns=number_slider, ConnectCorners=Toggle(True))
aworld = AntsWorld(gridworld)
ants = AntsCompoent(Script=panel, AWorld=aworld, Generations=Slider(5, range=0..10), Value=decodes.a)  # -> Value, List, AWorld
worldtolines = AntsGridToLines(AWorld=gridworld)
panel_2 = Panel(ants.List)
aworldselect = AntsWorldSelector(AWorld=ants.AWorld, Generation=Slider(4, range=0..10))
panel_3 = Panel(ants.AWorld)
panel_4 = Panel(aworldselect)
