# Grasshopper definition graphbypoints_tester.gh (Grasshopper 0.9.72)
# plug-ins: Ants

hexgrid = Hexagonal(Plane=PlaneXY(0, 0, 0), Size=1, ExtentX=5, ExtentY=5)  # -> flatten(Cells), flatten(Points)
number_slider = Slider(7, range=0..100)
geo = Geometry([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])
geo_2 = Geometry([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])
pt = Point(Point(9.3, 0, 0))
geo_3 = Geometry([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])
geo_4 = Geometry([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])
explode = Explode(Curve=hexgrid.Cells, Recursive=True)  # -> flatten(Segments), Vertices
pt_2 = Point(Point(-20.9, -9.6, 0))
geo_5 = Geometry([<curve referenced from the Rhino model> x2])
sqgrid = Square(Plane=pt, Size=1, ExtentX=5, ExtentY=5)  # -> flatten(Cells), Points
box = CenterBox(Base=pt_2, X=number_slider, Y=number_slider, Z=number_slider)
number_slider_2 = Slider(5, range=0..10)  # disabled
lnsgph = CreateGraphFromLines(Lines=explode.Segments)
pop3d = Populate3D(Region=box, Count=Slider(20, range=0..100), Seed=Slider(0.3, range=0..1))
crvgph = CreateGraphFromCurves(Curves=hexgrid.Cells, ConnectCorners=Toggle(False))
number_slider_3 = Slider(1.9, range=0..10)  # disabled
data = Data(pop3d)
sqgrid_2 = Square(Plane=PlaneXY(0, 0, 0), Size=1, ExtentX=number_slider_2, ExtentY=number_slider_2)  # -> Cells, flatten(Points); disabled
gphln = GraphToEdges(SpatialGraph=crvgph)
gphexp = GraphExplorer(SpatialGraph=crvgph, IndexOfNode=Slider(0, range=0..40))  # -> Points, Neighbors, Edges, Weights
ptsgph = CreateGraphFromPoints(Points=data, Dist=Slider(8.131, range=0..50))
ptsgph_2 = CreateGraphFromPoints(Points=sqgrid_2.Points, Dist=number_slider_3)
panel = Panel(gphexp.Weights)
panel_2 = Panel(crvgph)
sph = Sphere(Base=gphexp.Points, Radius=0.5)
sg = SpatialGraph(ptsgph)
panel_3 = Panel(gphexp.Neighbors)
pipe = Pipe(Curve=gphexp.Edges, Radius=0.2, Caps=0)
gphexp_2 = GraphExplorer(SpatialGraph=sg, IndexOfNode=Slider(16, range=0..50))  # -> Points, Neighbors, Edges, Weights
gphln_2 = GraphToEdges(SpatialGraph=sg)
panel_4 = Panel(gphexp_2.Weights)
sph_2 = Sphere(Base=gphexp_2.Points, Radius=0.5)
panel_5 = Panel(gphexp_2.Neighbors)
pipe_2 = Pipe(Curve=gphexp_2.Edges, Radius=0.2, Caps=0)
